# Grasshopper definition GPT_4.gh (Grasshopper 1.0.7)

# is KCAI going to start a computational design department?
# My wife does not think that it is wise for me to teach my kids to answer all there homework questions with this program.  What is your opinion?
# Should I take classes from Michael Wickerson in the sculpture department at KCAI?
# Is it possible for a 100 pound boy at age 13 to benchpress 65 pounds?
panel = Panel("Write me an artist startment about the life artwork of Michael David Wickerson, the sculptor in Kansas.")
# write a statement for linkedin that shows how useful it is to have ChatGPT in the Grasshopper 3D coding environment
# Will Max Wickerson ever get along with his sister Ella?
# what is the future of grasshopper for rhino3d now that chatgpt exists?
# Is the x = 2y*(45 + y) a linear equation? If not, why not?
panel_2 = Panel("C:\Users\Sculpture\Desktop\Openai\Key\KeyMichaelWickerson.txt")
send = BooleanToggle(True)
file = ReadFile(File=panel_2, PerLineParse=True)
chatgpt = GhPythonScript(api_key=file, request=panel, send=send)  # -> answer; inputs send: Boolean
# ---------- chatgpt: Python ----------
__author__ = "peter"
__version__ = "2023.01.18"

#calling peters api key on local files, to do: add in more json promts that link to api calls. could be good for uv map generations. 

import rhinoscriptsyntax as rs
import urllib2
import json


url = "https://api.openai.com/v1/completions"


data = json.dumps({ "model": "text-davinci-003", "prompt": request, "temperature": 0.5,  "max_tokens": 1024})
headers = { "Content-Type": "application/json", "Authorization": "Bearer {0}".format(api_key) }

answer = "Send to request to Open AI"

if send:

    req = urllib2.Request(url, data, headers)
    response = urllib2.urlopen(req)


    response_text = response.read()
    response_json = json.loads(response_text)


    answer = response_json["choices"][0]["text"]

print(answer)
# ---------- end chatgpt ----------
ghpython_script = GhPythonScript()  # -> Out, A
panel_3 = Panel(file)
panel_4 = Panel(chatgpt)
