# Grasshopper definition GPT_4_002.gh (Grasshopper 1.0.7)
# plug-ins: Hops

number_slider = Slider(3, range=0..10)
number_slider_2 = Slider(8.5, range=0..10)
number_slider_3 = Slider(8.03, range=0..10)
panel = Panel("""(a0 + a1 * np.exp(1j * t) + b1 * np.exp(-1j * t)
            + a2 * np.exp(2j * t) + b2 * np.exp(-2j * t)
            + a3 * np.exp(3j * t) + b3 * np.exp(-3j * t)
            + c1 * np.cos(t) + c2 * np.cos(2 * t) + c3 * np.cos(3 * t))""")
negative = Negative(Value=number_slider_2)
negative_2 = Negative(Value=number_slider_3)
construct_domain = ConstructDomain(DomainStart=negative, DomainEnd=number_slider_2)
construct_domain_2 = ConstructDomain(DomainStart=negative_2, DomainEnd=number_slider_3)
negative_3 = Negative(Value=Slider(0.1, range=0..0.1))
negative_4 = Negative(Value=Slider(0.1, range=0..0.1))
range = Range(Domain=construct_domain, Steps=number_slider)
range_2 = Range(Domain=construct_domain_2, Steps=number_slider)
# need numpy library
evaluate = Evaluate(
    Expression=panel,
    t=Slider(2, range=0..10),
    a0=Slider(0.5, range=0..1),
    a1=Slider(0.3, range=0..1),
    b1=Slider(0.1, range=0..0.1),
    a2=negative_4,
    b2=Slider(0.05, range=0..0.1),
    a3=Slider(0.05, range=0..0.1),
    b3=Slider(0.025, range=0..0.1),
    c1=Slider(0.05, range=0..0.1),
    c2=negative_3,
    c3=Slider(0.005, range=0..0.01))
complex2 = Hops(
    Real=graft(range),
    Imaginary=range_2,
    Z=Slider(0, range=0..10),
    CacheResultsInMemory=True,
    CacheSolveResults=True,
    RemoteDefinitionLocation="http://127.0.0.1:5000/complex2",
    RemoteSolveVersion=(0, 1, 0),
    ShowInput_Enabled=False,
    ShowInput_Path=False,
    SynchronousSolve=True)
complex = Hops(
    Real=graft(range),
    Imaginary=range_2,
    CacheResultsInMemory=False,
    CacheSolveResults=False,
    RemoteDefinitionLocation="http://127.0.0.1:5000/complex",
    RemoteSolveVersion=(0, 1, 0),
    ShowInput_Enabled=False,
    ShowInput_Path=False,
    SynchronousSolve=True)
complex2_2 = Hops(
    Real=graft(range),
    Imaginary=range_2,
    Z=Slider(4, range=0..10),
    CacheResultsInMemory=True,
    CacheSolveResults=True,
    RemoteDefinitionLocation="http://127.0.0.1:5000/complex2",
    RemoteSolveVersion=(0, 1, 0),
    ShowInput_Enabled=False,
    ShowInput_Path=False,
    SynchronousSolve=True)
complex2_3 = Hops(
    Real=graft(range),
    Imaginary=range_2,
    Z=Slider(10, range=0..10),
    CacheResultsInMemory=True,
    CacheSolveResults=True,
    RemoteDefinitionLocation="http://127.0.0.1:5000/complex2",
    RemoteSolveVersion=(0, 1, 0),
    ShowInput_Enabled=False,
    ShowInput_Path=False,
    SynchronousSolve=True)
panel_2 = Panel(complex)
panel_3 = Panel(complex2)
panel_4 = Panel(complex2_2)
panel_5 = Panel(complex2_3)
surface_from_points = SurfaceFromPoints(Points=flatten(panel_3), UCount=expr("x+1", number_slider), Interpolate=False)
surface_from_points_2 = SurfaceFromPoints(Points=flatten(panel_4), UCount=expr("x+1", number_slider), Interpolate=False)
surface_from_points_3 = SurfaceFromPoints(Points=flatten(panel_5), UCount=expr("x+1", number_slider), Interpolate=False)
deconstruct_brep = DeconstructBrep(Brep=surface_from_points)  # -> Faces, graft(Edges), Vertices
deconstruct_brep_2 = DeconstructBrep(Brep=surface_from_points_3)  # -> Faces, graft(Edges), Vertices
deconstruct_brep_3 = DeconstructBrep(Brep=surface_from_points_2)  # -> Faces, graft(Edges), Vertices
loft = Loft(
    Curves=[deconstruct_brep_2.Edges, deconstruct_brep_3.Edges],
    Options={Adjust=False, Closed=False, LoftEnds=0, LoftSimp=0, LoftType=0, Rebuild=10, Refit=0.01})
loft_2 = Loft(
    Curves=[deconstruct_brep.Edges, deconstruct_brep_3.Edges],
    Options={Adjust=False, Closed=False, LoftEnds=0, LoftSimp=0, LoftType=0, Rebuild=10, Refit=0.01})
