# Grasshopper definition GPT_4_005.gh (Grasshopper 1.0.7)
# plug-ins: Anemone, Bifocals

panel = Panel("Write me a better artist startment about")
# Write something more intelligent
# generate a more complex polynomial
panel_2 = Panel(" the life artwork of Michael David Wickerson, the sculptor in Kansas.")
concatenate = Concatenate(FragmentA=panel, FragmentB=panel_2)

panel_3 = Panel("C:\Users\Sculpture\Desktop\Openai\Key\KeyMichaelWickerson.txt")
file = ReadFile(File=panel_3, PerLineParse=True)
panel_4 = Panel(file)

loop_start = LoopStart(Repeat=Slider(2, range=0..7), Trigger=Toggle(True), Data=concatenate)  # -> port, Counter, Data
send = BooleanToggle(True)
chatgpt = GhPythonScript(api_key=file, request=loop_start.Data, send=send)  # -> answer; inputs send: Boolean
# ---------- chatgpt: Python ----------
__author__ = "peter"
__version__ = "2023.01.18"

#calling peters api key on local files, to do: add in more json promts that link to api calls. could be good for uv map generations. 

import rhinoscriptsyntax as rs
import urllib2
import json


url = "https://api.openai.com/v1/completions"


data = json.dumps({ "model": "text-davinci-003", "prompt": request, "temperature": 0.5,  "max_tokens": 1024})
headers = { "Content-Type": "application/json", "Authorization": "Bearer {0}".format(api_key) }

answer = "Send to request to Open AI"

if send:

    req = urllib2.Request(url, data, headers)
    response = urllib2.urlopen(req)


    response_text = response.read()
    response_json = json.loads(response_text)


    answer = response_json["choices"][0]["text"]

print(answer)
# ---------- end chatgpt ----------
loop_end = LoopEnd(port=loop_start.port, Exit=False, Data=chatgpt, TimeOutVal=0, pausedState=False, state="Constant output")
panel_5 = Panel(loop_end)
send_2 = BooleanToggle(True)
concatenate_2 = Concatenate(FragmentA=panel, FragmentB=loop_end)
chatgpt_2 = GhPythonScript(api_key=file, request=concatenate_2, send=send)  # -> answer; inputs send: Boolean; same code as chatgpt
panel_6 = Panel(chatgpt_2)
concatenate_3 = Concatenate(FragmentA=panel, FragmentB=chatgpt_2)
chatgpt_3 = GhPythonScript(api_key=file, request=concatenate_3)  # -> answer; inputs send: Boolean; same code as chatgpt
panel_7 = Panel(chatgpt_3)
concatenate_4 = Concatenate(FragmentA=panel)
chatgpt_4 = GhPythonScript(api_key=file, request=concatenate_4)  # -> answer; inputs send: Boolean; same code as chatgpt
loop_end_2 = LoopEnd(Exit=False, Data=chatgpt_4, TimeOutVal=0, pausedState=False, state="Constant output")
