# Grasshopper definition GPT_4_008.gh (Grasshopper 1.0.7)
# plug-ins: Bifocals, Anemone

# I always wanted to get my head around the @hops.component decorator.
# 
# Turns out it has to do with classes in python.
# 
# 
# 
# Here is an app .py file that should explain it all in a few hundred lines of code.
# 
# I drew it out a bit and allowed github copilot to do all the teaching with a few prompts from my python textbook.
# Data Scientist,
# 
# 
# 
# this is a small geometric script
# 
# example app showing how to
# 
# "tuck" some of the .gh canvas nodes
# 
# back into the @hops.component in VSC
# 
# with python scripting
# Automate Grasshopper with Hops With Github Co-Pilot into Grasshopper for Rhino3D
# 
# 
# 
# Introduction
# 
# Flow Control
# 
# Import Modules
# 
# Functions
# 
# Lists (working with lists)
# 
# Conways Game of Life
# 
# Manipulating Strings
# 
# Short Programs
# 
# Pattern Matching with Regular Expressions
# 
# Input Validation
# 
# Reading and Writing Files
# 
# 
# 
# Grasshopper Rhino Hops VSC @ www.wickersonstudios.com
# 
# 
# 
# Instructions:
# Rhino3dm_Hops_Curve_MASTER
# 
# 
# 
# GUIDE TO SETTING UP RHINO CURVE MENU IN GRASSHOPPER THROUGH AN app.py IN VSC WITH THE ghhops_server and Flask
# 
# 
# 
# TONS OF @hops.components (use openAI, chatGPT and/or github copilot to extend the app)
# 
# 
# 
# Grasshopper Rhino Hops VSC @ www.wickersonstudios.com
# 
# 
# 
# Instructions:
# chatgpt into GRASSHOPPER 2.0
# 
# 
# 
# Creative chatGPT scripts into Grasshopper Geometries
# 
# *special thanks to Peter Davis' open source chatGPT node
# 
# 
# 
# 20 CREATIVE chatCPT scripts into Grasshopper 2.0 Geometries at Wickerson Studios
# 
# 
# 
# INTRODUCTION TO WORKING WITH TEXT WITH chatGPT INTO ANY AND ALL NODES IN GRASSHOPPER 2.0
# 
# 
# 
# Resources to learn parametric and computational design in node scripting with Grasshopper 2.0 for Rhino3D.
# generate the C# script for a C# node in grasshopper that produces two beautiful trigonometry curves that can be output lofted
# 
# 
# 
# HOW CHATGPT TAUGHT ME TO TALK TO CHATGPT
# 
# and
# 
# WHEN TO USE GHPYTHON OR C# NODES, THE C# PARASITE AND VSC
# 
# and
# 
# WHEN TO TRANSFER INTO GITHUB-COPILOT
# Translating chatGPT node into Grasshopper Geometry at Wickerson Studio
# 
# 
# 
# INTRO - FILLING PARAM CONTAINER NODES IN GRASSHOPPER
# 
# and
# 
# WHEN TO JUMP OVER TO GITHUB COPILOT IN VSC
# NUMPY: Python's Wildly Important Library!!! DATA SCIENCE
# 
# Grasshopper Rhino Hops VSC
# 
# Instructions
# 
# 1. Open Anaconda3 Navigator
# 
# 2. Launch Powershell Prompt
# 
# 3. pip install ghhops_server flask
# 
# 4. pip install (all necessary python 3.0 libraries like numpy, pandas, scikit-learn etc...)
# 
# 5. Open Rhino and Grasshopper and load the .gh scripts one at a time into Rhino7
# 
# 6. Open Visual Studio Code (VSC)
# 
# 7. Open folder... Select Folder
# 
# 8. Click on Folder in VSC and click app.py
# 
# 9. select Terminal -> New Terminal and size at bottom of app.py script
# 
# 10. press F5 and select Flask Launch and debug with Flask application
# 
#   Test #1...
# 
# 11. Disconnect and reconnect wire to the Hops component on the Grasshopper Canvas
# 
# 
# 
# 
# 
# 
# 
# 
# 
# Resources to learn parametric and computational design in node scripting with Grasshopper for Rhino3D.
panel = Panel("""NUMPY: Python's Wildly Important Library!!! DATA SCIENCE

Grasshopper Rhino Hops VSC 

Instructions

1. Open Anaconda3 Navigator

2. Launch Powershell Prompt

3. pip install ghhops_server flask

4. pip install (all necessary python 3.0 libraries like numpy, pandas, scikit-learn etc...)

5. Open Rhino and Grasshopper and load the .gh scripts one at a time into Rhino7

6. Open Visual Studio Code (VSC)

7. Open folder... Select Folder

8. Click on Folder in VSC and click app.py

9. select Terminal -> New Terminal and size at bottom of app.py script

10. press F5 and select Flask Launch and debug with Flask application

  Test #1...

11. Disconnect and reconnect wire to the Hops component on the Grasshopper Canvas

 







Resources to learn parametric and computational design in node scripting with Grasshopper for Rhino3D.""")
# 10 Algorithms for Searching and Sorting with Python in Grasshopper
# 
# 
# 
# Grasshopper Rhino Hops VSC @ www.wickersonstudios.com
panel_2 = Panel("Write a clear, concise and intelligent title and marketing pitch for ")
concatenate = Concatenate(FragmentA=panel_2, FragmentB=panel)

panel_3 = Panel("C:\Users\Sculpture\Desktop\Openai\Key\KeyMichaelWickerson.txt")
file = ReadFile(File=panel_3, PerLineParse=True)
panel_4 = Panel(file)

loop_start = LoopStart(Repeat=Slider(0, range=0..9), Trigger=Toggle(False), Data=concatenate)  # -> port, Counter, Data
send = BooleanToggle(True)
chatgpt = GhPythonScript(api_key=file, request=loop_start.Data, send=send)  # -> answer; inputs send: Boolean
# ---------- chatgpt: Python ----------
__author__ = "peter"
__version__ = "2023.01.18"

#calling peters api key on local files, to do: add in more json promts that link to api calls. could be good for uv map generations. 

import rhinoscriptsyntax as rs
import urllib2
import json


url = "https://api.openai.com/v1/completions"


data = json.dumps({ "model": "text-davinci-003", "prompt": request, "temperature": 0.5,  "max_tokens": 1024})
headers = { "Content-Type": "application/json", "Authorization": "Bearer {0}".format(api_key) }

answer = "Send to request to Open AI"

if send:

    req = urllib2.Request(url, data, headers)
    response = urllib2.urlopen(req)


    response_text = response.read()
    response_json = json.loads(response_text)


    answer = response_json["choices"][0]["text"]

print(answer)
# ---------- end chatgpt ----------
loop_end = LoopEnd(port=loop_start.port, Exit=False, Data=chatgpt, TimeOutVal=0, pausedState=False, state="Constant output")
panel_5 = Panel(loop_end)
