# Grasshopper definition working_with_classes_001.gh (Grasshopper 1.0.7)
# plug-ins: Hops

# WORKING WITH CLASSES
panel = Panel("Michael Wickerson")
sculpture_faculty = Hops(
    Name=panel,
    Department="Sculpture",
    CacheResultsInMemory=True,
    CacheSolveResults=True,
    RemoteDefinitionLocation="http://127.0.0.1:5000/sculpture_faculty",
    RemoteSolveVersion=(0, 1, 0),
    ShowInput_Enabled=False,
    ShowInput_Path=False,
    SynchronousSolve=True)  # -> Name, Department
panel_2 = Panel([sculpture_faculty.Name, sculpture_faculty.Department])
